# Grasshopper definition kmeans.ghx (Grasshopper 0.9.76)
# plug-ins: Python Interpreter

path = FilePath("C:\Users\T440p\Downloads\mamm.csv")
path_2 = FilePath("C:\4.projects\ML\gh_data\main\iris_data_set.csv")
file = ReadFile(File=path_2, PerLineParse=True)
file_2 = ReadFile(File=path, PerLineParse=True)
path_3 = FilePath("C:\Users\T440p\Downloads\wisconsin_cancer.csv")
file_3 = ReadFile(File=path_3, PerLineParse=True)
panel = Panel("""1
5
9""")
panel_2 = Panel("""0
2
4""")
pt = Point(graft([<point referenced from the Rhino model> x3]))
rep = ReplaceText(Text=file_3, Find="M", Replace="0", RecursiveReplace=False)
graft = GraftTree(Tree=panel_2, IncludeEmptyLists=True, IncludeNullItems=True)
graft_2 = GraftTree(Tree=panel, IncludeEmptyLists=True, IncludeNullItems=True)
split = TextSplit(Text=file, Separators=";")
rep_2 = ReplaceText(Text=rep, Find="B", Replace="1", RecursiveReplace=False)
panel_3 = Panel("""1
5
9""")
panel_4 = Panel("""0
2
4""")
lng = ListLength(List=split)
item = ListItem(List=split, Index=0, Wrap=True)  # -> Item, Item1, Item2, Item3
item_2 = ListItem(List=split, Index=0, Wrap=True)  # -> Item, Item1, Item2, Item3, Item4
random = Random(Range=Domain(0, 1), Number=25, Seed=8)
random_2 = Random(Range=Domain(0, 1), Number=25, Seed=6)
flatten = FlattenTree(Tree=pt, Path="{0}")
graft_3 = GraftTree(Tree=panel_4, IncludeEmptyLists=True, IncludeNullItems=True)
graft_4 = GraftTree(Tree=panel_3, IncludeEmptyLists=True, IncludeNullItems=True)
split_2 = SplitList(List=split, Index=expr("x-1", lng))  # -> ListA, ListB
lng_2 = ListLength(List=flatten)
X = UnitX(Factor=pt)
Z = UnitZ(Factor=pt)
panel_5 = Panel(lng_2)
random_3 = Random(Range=Domain(0.1, 0.25), Number=25, Seed=graft_3)
random_4 = Random(Range=Domain(0, 360), Number=25, Seed=graft_4)
amp = Amplitude(Vector=X, Amplitude=1)
sph = Sphere(Base=PlaneXY(0, 0, 0), Radius=0.5)
pt_2 = ConstructPoint(XCoordinate=random_2, YCoordinate=random, ZCoordinate=0)
rad = Radians(Degrees=random_4)
join = TextJoin(Text=split_2.ListA, Join=",")
series = Series(Start=0, Step=1, Count=10)
vrot = Rotate(Vector=amp, Axis=Z, Angle=rad)
jitter = Jitter(List=vrot, Jitter=1, Seed=4)  # -> Values, Indices
evalsrf = EvaluateSurface(Surface=reparameterize(sph), Point=pt_2)  # -> Point, Normal, Frame
amp_2 = Amplitude(Vector=jitter.Values, Amplitude=random_3)
flatten_2 = FlattenTree(Tree=join, Path="{0}")
pt_3 = ConstructPoint(XCoordinate=item.Item, YCoordinate=item.Item1, ZCoordinate=item.Item3)  # -> flatten(Point)
move = Move(Geometry=simplify(pt), Motion=simplify(amp_2))  # -> Geometry, Transform
pt_4 = Point(evalsrf.Point)
pt_5 = ConstructPoint(XCoordinate=item.Item, YCoordinate=item.Item2, ZCoordinate=item.Item3)  # -> flatten(Point)
pt_6 = ConstructPoint(XCoordinate=item.Item1, YCoordinate=item.Item2, ZCoordinate=item.Item3)  # -> flatten(Point)
pt_7 = ConstructPoint(XCoordinate=item.Item, YCoordinate=item.Item1, ZCoordinate=item.Item2)  # -> flatten(Point)
number_slider = Slider(0.25, range=0..1)
pt_8 = Point(graft([<point referenced from the Rhino model> x3]))
path_4 = FilePath("C:\4.projects\ML\gh_data\main\kmeans.py")
filter = StreamFilter(Gate=Slider(0, range=0..3), Stream0=pt_7, Stream1=pt_6, Stream2=pt_5, Stream3=pt_3)
file_4 = ReadFile(File=path_4, PerLineParse=False)
box = DomainBox(Base=pt_8, X=" 0 To .25", Y=" 0 To .25", Z=" 0 To .25")
sph_2 = Sphere(Base=pt_8, Radius=number_slider)
msphere = MeshSphere(Base=pt_8, Radius=number_slider, UCount=10, VCount=20)
kmeans = PythonScript(Code=file_4, C_num=Slider(3, range=0..10), Data_set=flatten_2)  # -> Out, A, C_points, Labels, Centroids, Centr, Tokens
popgeo = PopulateGeometry(Geometry=msphere, Count=Slider(25, range=0..100), Seed=1)
pop3d = Populate3D(Region=box, Count=100, Seed=Slider(6, range=0..10))
pt_9 = Point(flatten(pop3d))
pdecon = Deconstruct(Point=graft(pt_9))  # -> XComponent, YComponent, ZComponent
panel_6 = Panel(pt_9)
merge = Merge(Data1=pdecon.XComponent, Data2=pdecon.YComponent, Data3=pdecon.ZComponent)
join_2 = TextJoin(Text=merge, Join=",")
flatten_3 = FlattenTree(Tree=join_2, Path="{0}")
panel_7 = Panel(kmeans.Out)
random_5 = Random(Range=Domain(0, 10), Number=10, Seed=2)
python = PythonScript(x=random_5)  # -> out, a; inputs x: list
# ---------- python: Python ----------
a = [float(i)/max(x) for i in x]
# ---------- end python ----------
panel_8 = Panel(python.a)
pt_10 = ConstructPoint(XCoordinate=item.Item, YCoordinate=item.Item1, ZCoordinate=item.Item2)
panel_9 = Panel(random_5)
col = Colour([ColourSwatch(SwatchColor=RGB(94, 191, 255)), ColourSwatch(SwatchColor=RGB(255, 56, 202)), ColourSwatch(SwatchColor=RGB(56, 255, 96)), ColourSwatch(SwatchColor=RGB(255, 228, 56))])
flatten_4 = FlattenTree(Tree=filter, Path="{0}")
lng_3 = ListLength(List=flatten_4)  # -> expr("x-1", Length)
item_3 = ListItem(List=split_2.ListB, Index=5, Wrap=True)
item_4 = ListItem(List=col, Index=kmeans.Labels, Wrap=True)
range = Range(Domain=lng_3, Steps=lng_3)
flatten_5 = FlattenTree(Tree=split_2.ListB, Path="{0}")
int = Integer(range)
flatten_6 = FlattenTree(Tree=item_3, Path="{0}")
python_2 = PythonScript(x=flatten_5)  # -> out, labels_int; inputs x: list
# ---------- python_2: Python ----------
names = list(set(x))
labels_int = []
for i, name in enumerate(names):
    for label in x:
        if label == name:
            labels_int.append(i)
# ---------- end python_2 ----------
python_3 = PythonScript(x=kmeans.Labels, y=python_2.labels_int)  # -> out, a; inputs x: list, y: list
# ---------- python_3: Python ----------
_d = 1
for k,j in enumerate(x):
    if j != y[k]:
        _d += 1
a = _d
# ---------- end python_3 ----------
panel_10 = Panel(python_3.a)
fragment = TextFragment(Text=flatten_5, Start=5, Count=3)
fragment_2 = TextFragment(Text=flatten_5, Start=5, Count=3)
tag = TextTag(Location=flatten_4, Text=flatten_6, Colour=item_4)
