# Grasshopper definition read_csv.ghx (Grasshopper 0.9.76)
# plug-ins: Python Interpreter

read_csv = Read_csv()  # -> out, data; inputs csv_data: list, headers: list
# ---------- read_csv: Python ----------
from Grasshopper.Kernel.Data import GH_Path
from Grasshopper import DataTree

list_split = [x.split(delimiter) for x in csv_data]
flip = zip(*list_split)
headers_from_csv = [y[0] for y in flip]
col_data = []
for head in headers:
    if head in headers_from_csv:
        ind = headers_from_csv.index(head)
        col_data.append(flip[ind][1:])
    else:
        col_data.append([])
#    else:
#        col_data = None
#        print 'no header of such name in csv, or wrong delimiter'
data = DataTree[object]()
if col_data:
    for i in range(len(col_data)):
        data.AddRange(col_data[i],GH_Path(i))

#for col in flip:
#    print col[0]
#    print header
#    if col[0] == header:
#        col_data = col[1:]
#    else:
#        col_data = None
#if flip[0] == header
#a = 
#print flip[0]
# ---------- end read_csv ----------
